# Requirement set Function_Requirements (R2024a)

## 1 [#1] Stateflow LKA Initialization
These requirements are for the initialization of Lane Keep Assist (LKA).

### 1.1 [1.a] LKA Initialization Conditions
LKA initializes when LKA Enable state is selected, Perception module can detect and identify the lanes.

### 1.2 [1.b] LKA Init for Lane Departure
When lane departure warning displays, LKA should be initalize again after 1.2 sec.

## 2 [2] Stateflow LKA Activitation
This requirement is for the LKA active state.

### 2.1 [2.a] LKA in Active State
LKA should be active when the sum of lateral offset and orientation error is less than half of lane width.

## 3 [3] Stateflow Lane Departure Warning
These requirements are for the Lane Deoparture Warninig state.

### 3.1 [3.a] Display Lane Departure Warning
Lane Departure Warning (LDW) should be displayed when the sum of lateral offset and orientation error is more than half of lane width.

### 3.2 [3.b] LDW for excess acceleration
Lane Departure Warning (LDW) should be displayed when SV lateral acceleration crosses the defined threshold acceleration value.

## 4 [4] Stateflow Driver Control
These requiremnets are for the giving control to the driver (Driver Control state) under different conditions.

### 4.1 [4.a] LKA Disable
Ego Vehicle should give control to the driver (driver control state), when LKA Mode is disabled.

### 4.2 [4.b] No Detection
Ego Vehicle should give control to the driver (driver control state), when perception module can not detect and identify the lanes.

## 5 [5] Stanley Controller

### 5.1 [5.a] Steering Angle
Steering angle for the lane to be followed.

## 6 [6] MPC

### 6.1 [6.a] Throttle
Throttle for the lane to be followed.

### 6.2 [6.b] Brake
Brake when the lane departure selected to follow the lane.